# Grasshopper definition cage_morph_last.gh (Grasshopper 1.0.7)
# Copyright: mrtn.ch
# plug-ins: Fattener

mesh = Mesh(<mesh referenced from the Rhino model>)
mesh_2 = Mesh(<mesh referenced from the Rhino model>)
demesh = DeconstructMesh(Mesh=mesh_2)  # -> Vertices, Faces, Colours, Normals
mesh_3 = Mesh(<mesh referenced from the Rhino model>)
mcm = MeshCageMorph(Points=demesh.Vertices, Reference=mesh, Target=mesh_3, CalculateWeightings=Button())
conmesh = ConstructMesh(Vertices=mcm, Faces=demesh.Faces)
