# Grasshopper definition cage_morph_last_subd.gh (Grasshopper 1.0.7)
# Copyright: mrtn.ch
# plug-ins: Fattener

mesh = Mesh(<mesh referenced from the Rhino model>)
subd = SubD(<subd referenced from the Rhino model>)
demesh = DeconstructMesh(Mesh=subd)  # -> Vertices, Faces, Colours, Normals
mesh_2 = Mesh(<mesh referenced from the Rhino model>)
mcm = MeshCageMorph(Points=demesh.Vertices, Reference=mesh, Target=mesh_2, CalculateWeightings=Button())
conmesh = ConstructMesh(Vertices=mcm, Faces=demesh.Faces)
subdmesh = SubDFromMesh(Mesh=conmesh, Creases=1, Corners=1, Interpolate=False)
